# Grasshopper definition Crossection_Material_testing.gh (Grasshopper 1.0.7)
# plug-ins: Karamba, karambaToSofistik

# Currently Supported:
# 
# - Beams
# - Custom Materials
# - Supports
# - Gravity, Point-load, Line-Load
# - Cross-sections: Box, Circular, I profile and Trapezoidal
# - Load-cases
# - First order analysis
# 
# - Sofistik calculation directly from Grasshopper
# - Retrieving Beam Forces from Sofistik
# 
# 
# Not (Yet) Supported:
# - Shells/meshes
# - Springs
# - Joints
# - Beam-sets / beam-groups
# - Temp, prestress, imperfection loads
# - Multi-order analysis
# - Visualization tools for Sofistik results
number_slider = Slider(1, range=0..100)
loads = LoadsKaramba3D(Vector=Vector(0, 0, -1), LCase="1", mode="Gravity")
pt = Point([Point(0, 14.97443729, 9.858472754), Point(12.27182831, 14.97443729, 9.858472754), Point(0, 0.0414951468, 9.858472754), Point(12.27182831, 0.0414951468, 9.858472754)])

pt_2 = Point([Point(12.27182831, 14.97443729, -0.02955650405), Point(12.27182831, 0.0414951468, -0.02955650405), Point(0, 0.0414951468, -0.02955650405), Point(0, 14.97443729, -0.02955650405)])
# TESTCASE definition
crv = Curve([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])
pt_3 = Point([Point(0, 14.97443729, 9.858472754), Point(12.27182831, 14.97443729, 9.858472754), Point(0, 0.0414951468, 9.858472754), Point(12.27182831, 0.0414951468, 9.858472754)])
Z = UnitZ(Factor=expr("-X", number_slider))
supp = SupportKaramba3D(PosInd=pt_2, menu=[buttons(on, on, on, on, on, on)])
crosecselect = CrossSectionSelectorKaramba3D(NameOrListIndexOfCrossSection="IPE600")  # -> CrossSection, Info
loads_2 = LoadsKaramba3D(ForceVector=Z, Local=False, PosInd=pt_3, LCase="1", mode="Point")  # -> flatten(Load)
linetobeam = LineToBeamKaramba3D(Line=crv, New=True, Remove=True, LimitDistance_m=0.005)  # -> Element, Points, Info

item = ListItem(List=pt_3, Index=0, Wrap=True)  # -> Item, Item1, Item2, Item3
X = UnitX(Factor=Slider(0.5, range=0..1))
conmesh = ConstructMesh(Vertices=[item.Item, item.Item1, item.Item3, item.Item2], Faces={A=0, B=1, C=2, D=3})
loads_3 = LoadsKaramba3D(ForceVector=X, Local=False, PosInd=pt, LCase="1", mode="Point")  # -> flatten(Load)
meshtoshell = MeshToShellKaramba3D(Mesh=conmesh, LimitDistance_m=0.005)  # -> Element, Points, Info
assemble = AssembleModelKaramba3D(
    Elem=flatten(linetobeam.Element),
    Support=flatten(supp),
    Load=[loads_2, loads_3, loads],
    CrossSection=crosecselect.CrossSection,
    LimitDistance_m=0.005)  # -> Model, Info, Mass_kg, CenterOfGravity

# ---- group: Sofistik Converter
karsof = KarambaToSofistik(Model=assemble.Model, BeamDivision=Slider(5, range=0..10))  # -> Sofistik, Log

# ---- group: Karamba Analysis
analyze = AnalyzeKaramba3D(Model=assemble.Model)  # -> CalculatedModel, MaximumDisplacement_cm, ResultingForceOfGravity_kN, ElasticEnergy_kNm
modelview = ModelViewKaramba3D(Model=analyze.CalculatedModel, LoadCaseFactorsForLinearSuperposition=1, IndexOfVisibleLoadcase=-1)  # -> Model, DeformedMesh, DeformedAxes, DeformedModel
beamview = BeamViewKaramba3D(Model=modelview.Model)  # -> Model, MeshesOfRenderedBeams, DeformedBeamAxes, LegendColors, LegendTags

# ----
panel = Panel(karsof.Log)
panel_2 = Panel(karsof.Sofistik)

# ---- group: Add Own Extra Program Here
panel_3 = Panel("")

# ----
concat = Concatenate(FragmentA=panel_2, FragmentB=panel_3)

# ---- group: Sofistik Exporter
# PRESS BUTTON TO CALCULATE
button = Button()
calc_sof = CalculateSofistik(Sofistik=concat, Calculate=button, OpenTeddy=Button(), SolverOptions="2")

# ---- group: Sofistik Data Retriever
timer = Timer(TimerInterval=500, Target=calc_sof_2)
calc_sof_2 = CalculateSofistik(Sofistik=calc_sof)  # -> BeamForces, N, Vy, Vz, My, Mz, Status
panel_4 = Panel(calc_sof_2.Status)

# ----
b_res_force = BeamResultantForcesKaramba3D(AnalyzedModel=beamview.Model, LoadCase=-1, MaximumProbingDistance_m=-1, NumberOfProbingPointsPerElement=3)  # -> AnalyzedModel, NormalForce_kN, ResultantBendingMoment_kNm, ResultantShearForce_kN
bang = ExplodeTree(Data=b_res_force.NormalForce_kN)  # -> Branch0, Branch1
cull = CullPattern(List=calc_sof_2.N, CullPattern=[False, False, True])
# Normal/Axial Forces From Karamba
panel_5 = Panel(bang.Branch1)
# Normal/Axial Forces From Sofistik
panel_6 = Panel(cull)
panel_7 = Panel(calc_sof_2.BeamForces)
python = GhPythonScript(x=panel_6, y=panel_5)  # -> out, a; inputs x: list, y: list
# ---------- python: Python ----------
f = []
for i in range(len(x)):
    if x[i] == y[i]: f.append("0 %")
    else:
        f.append("Sofistik is " + str(round((abs(x[i]) - abs(y[i]))/y[i]*100)) + "% higher/lower than Karamba")
        
a = f
# ---------- end python ----------
# Difference N
# LARGE DIFFERENCE
panel_8 = Panel(python.a)
